# Grasshopper definition ex1_assembly_playground.ghx (Grasshopper 1.0.8)
# plug-ins: RhinoCodePluginGH

# ----
# Create a part
toggle = BooleanToggle(False)
part = Python3Script()  # -> out, part
# ---------- part: Python ----------
from compas.geometry import Frame
from compas.geometry import Vector
from compas.geometry import Box

from assembly_information_model import Part

# dimensions
width = 0.020
length = 0.23
height = 0.005

# create parte
center_frame = Frame([0., 0., 0.], [0, 1, 0], [1, 0, 0]) #center of the box frame 
part_geometry = Box(width, length, height, center_frame, 'box')

part = Part.from_shape(part_geometry, name="Part", frame=center_frame)
# ---------- end part ----------
show = Python3Script(my_part=part.part, show=toggle)  # -> out, plane, mesh
# ---------- show: Python ----------
from compas_rhino.conversions import mesh_to_rhino, box_to_rhino, frame_to_rhino


if show:

    #extract the mesh of the part for visulization
    compas_mesh = my_part.get_mesh()
    #convert to rhino mesh
    mesh = mesh_to_rhino(compas_mesh)
    
    #extract the frame of the part for visulization
    frame = my_part.frame
    #convert to rhino plane
    plane = frame_to_rhino(frame)
# ---------- end show ----------
pln = Plane(show.plane)
geo = Geometry(show.mesh)

# ----
# Unload Python modules
button = Button()
unload = Python3Script(unload=button)  # -> out, a
# ---------- unload: Python ----------
from compas_rhino import unload_modules

unload_modules('assembly_information_model')
unload_modules('assembly_information_model.assembly')
unload_modules('assembly_information_model.part')
# ---------- end unload ----------

# ----
# Create an empty assembly
button_2 = Button()
assembly = Python3Script(init=button_2)  # -> out, assembly
# ---------- assembly: Python ----------
from assembly_information_model.assembly import Assembly

#create empty assembly
assembly = Assembly()
# ---------- end assembly ----------

# ----
# Generate a rotational tower with parts
cp = Plane(PlaneXY(0.4, 0.4, 0))
generate_parts = Python3Script(part=part.part, assembly=assembly.assembly, center_plane=cp)  # -> out, assembly; inputs center_plane: Plane
# ---------- generate_parts: Python ----------
import math

from compas.geometry import Frame, Point
from compas.geometry import Transformation, Rotation, Translation
from compas_rhino.conversions import plane_to_compas_frame


center_frame = plane_to_compas_frame(center_plane)


for i in range(25): # loop through the number of layers i
    
    axis = center_frame.zaxis
    angle = math.radians(i*3)

    # create a Rotation matrix
    R = Rotation.from_axis_and_angle(axis, angle, point=center_frame.point) #Calculates a ``Rotation`` from a rotation axis and an angle and an optional point of rotation.

    # create a Translation matrix
    T = Translation.from_vector([0,0,0.005*i])

    # get a transformed copy of the original center frame
    center_frame_transformed = center_frame.transformed(R * T)

    if i%2 == 0:
        R = Rotation.from_axis_and_angle(center_frame_transformed.zaxis, math.radians(90), point=center_frame_transformed.point)
        # get a transformed copy of the original center frame
        center_frame_transformed = center_frame_transformed.transformed(R)

          
    add = math.sin(i/5)*0.015
    #print(add)
    
    o1 = center_frame_transformed.point + center_frame_transformed.yaxis*(0.075+add)
    o2 = center_frame_transformed.point - center_frame_transformed.yaxis*(0.075+add)
    
    f1 = Frame(o1, center_frame_transformed.xaxis, center_frame_transformed.yaxis)
    f2 = Frame(o2, center_frame_transformed.xaxis, center_frame_transformed.yaxis)
    
    T1 = Transformation.from_frame_to_frame(Frame.worldXY(), f1)
    T2 = Transformation.from_frame_to_frame(Frame.worldXY(), f2)

    # create new transformed instances of the part
    part_A = part.transformed(T1) #returns a deep copy of the initial element at the new location of the frame
    part_B = part.transformed(T2)

    # add parts to the assembly
    assembly.add_part(part_A)
    assembly.add_part(part_B)
# ---------- end generate_parts ----------
cp_new = Plane(PlaneXY(0.8, 0.4, 0))
transform = Python3Script(assembly=generate_parts.assembly, transform=Toggle(False), center_plane=cp, center_plane_new=cp_new)  # -> out, assembly
# ---------- transform: Python ----------
from compas.geometry import Frame, Transformation, Rotation, Translation
from compas_rhino.conversions import plane_to_compas_frame

center_frame = plane_to_compas_frame(center_plane)
center_frame_new = plane_to_compas_frame(center_plane_new)


if transform:
    T = Transformation.from_frame_to_frame(center_frame, center_frame_new)
    assembly = assembly.transformed(T)
# ---------- end transform ----------

reset = Button()
back = Button()
start = Button()
stop = Button()
step = Button()
full = Button()
list = ValueList({"20", "50", "100", "500", "1000", "5000"}, selected="500")
counter = Python3Script(assembly=transform.assembly, start=start, stop=stop, step=step, step_back=back, reset=reset, full=full, interval=list)  # -> out, counter
# ---------- counter: Python ----------
from scriptcontext import sticky as st
import Grasshopper

def update_component(ghenv, delay):
    """Schedule an update of the Grasshopper component.

    After the specified delay, the GH component will be automatically updated.

    Parameters
    ----------
    ghenv : :class:`GhPython.Component.PythonEnvironment`
        The current GHPython environment.
    delay : :obj:`int`
        Time in milliseconds until the update is performed.

    Raises
    ------
    ValueError
        If the delay is less than zero.

    """
    if delay <= 0:
        raise ValueError("Delay must be greater than zero")

    ghcomp = ghenv.Component
    ghdoc = ghcomp.OnPingDocument()

    def callback(ghdoc):
        if ghdoc.SolutionState != Grasshopper.Kernel.GH_ProcessStep.Process:
            ghcomp.ExpireSolution(False)

    ghdoc.ScheduleSolution(delay, Grasshopper.Kernel.GH_Document.GH_ScheduleDelegate(callback))

L = range(assembly.graph.number_of_nodes())

# store data in component
guid = str(ghenv.Component.InstanceGuid)
counter_key = "counter_" + guid
running_key = "running_" + guid

if counter_key not in st:
    st[counter_key] = 0

if running_key not in st:
    st[running_key] = False
    

if st[running_key]:
    if st[counter_key] < len(L) - 1:
        st[counter_key] += 1
        update_component(ghenv, interval)
    else:
        st[counter_key] = 0
        st[running_key] = False
    
if start:
    st[running_key] = True

if stop:
    st[running_key] = False

if step:
    if st[counter_key] < len(L) - 1:
        st[counter_key] += 1

if step_back:
    if st[counter_key] < len(L) - 1:
        st[counter_key] -= 1

if reset:
    st[counter_key] = 0
    st[running_key] = False

if full:
    st[counter_key] = len(L)-1

if len(L):
    item = L[st[counter_key]]


#st["visualisation_counter"] = st[counter_key]
counter = st[counter_key]+1
# ---------- end counter ----------
panel = Panel(counter.counter)

# ----
# Draw
list_2 = ValueList({"show all": "show_all", "show until key": "show_until_key"}, selected="show until key")
visualize = Python3Script(assembly=transform.assembly, show=list_2, highlight_current_part=Toggle(False), counter=counter.counter)  # -> out, parts_geometry, parts_frame, current_part_geometry, current_part_frame
# ---------- visualize: Python ----------
from compas_rhino.conversions import mesh_to_rhino, box_to_rhino, frame_to_rhino

#print assembly
print(assembly)

#get parts datastructure
parts = [p for p in assembly.parts()]

#get current part



if show == "show_all":
    
    #extract the mesh of the parts for visulization (+ converted to rhino mesh)
    parts_geometry = [mesh_to_rhino(p.get_mesh()) for p in parts]
    
    #extract the frame of the parts for visulization (+ converted to rhino plane)
    parts_frame = [frame_to_rhino(p.frame) for p in parts]

    key = assembly.graph.number_of_nodes()-1

if show == "show_until_key":
    #extract the mesh of the parts for visulization (+ converted to rhino mesh)
    parts_geometry = [mesh_to_rhino(p.get_mesh()) for p in parts[0:counter]]
    
    #extract the frame of the parts for visulization (+ converted to rhino plane)
    parts_frame = [frame_to_rhino(p.frame) for p in parts[0:counter]]

    key = counter-1

if highlight_current_part:
    current_part = assembly.part(key)
    current_part_geometry = mesh_to_rhino(current_part.get_mesh())
    current_part_frame = frame_to_rhino(current_part.frame)
# ---------- end visualize ----------
panel_2 = Panel(visualize.out)
geo_2 = Geometry(visualize.parts_geometry)
geo_3 = Geometry(visualize.parts_frame)
geo_4 = Geometry([visualize.current_part_geometry, visualize.current_part_frame])
preview = CustomPreview(Geometry=geo_3, Material=ColourSwatch(SwatchColor=RGB(255, 125, 157)))
preview_2 = CustomPreview(Geometry=geo_4, Material=ColourSwatch(SwatchColor=RGB(255, 125, 157)))
preview_3 = CustomPreview(Geometry=geo_2, Material=ColourSwatch(SwatchColor=RGBA(255, 227, 227, 233)))
