# Grasshopper definition ex2_brickwall.ghx (Grasshopper 1.0.7)

reload = Button()
py = PythonScript(reload=reload)
# ---------- py: Python ----------
from compas_rhino.utilities.misc import get_tolerance
from compas_rhino.utilities.misc import unload_modules

from compas_ghpython import unload_modules
unload_modules("compas")
unload_modules("compas_fab")
unload_modules("assembly_information_model")
unload_modules("ur_fabrication_control")
# ---------- end py ----------

# ----
# Element
# Predefine a brick element and its dimensions
# Visualise the defined element
show = BooleanToggle(False)
elem_def = GhPythonScript()  # -> out, elem_full, elem_half
# ---------- elem_def: Python ----------
import os
import sys
import json

from compas.geometry import Frame
from compas.geometry import Vector
from compas.geometry import Box

from assembly_information_model.assembly import Element


# dimensions full brick
width = 0.115
length = 0.240
height = 0.050

elem_full = Element.from_dimensions(length, width, height)
elem_full.tool_frame = Frame([0, 0, height], [1, 0, 0], [0, -1, 0])

elem_half = Element.from_dimensions(length/2, width, height)
elem_half.tool_frame = Frame([0, 0, height], [1, 0, 0], [0, -1, 0])
# ---------- end elem_def ----------
draw = PythonScript(elem_full=elem_def.elem_full, elem_half=elem_def.elem_half, show=show)  # -> M, F, S
# ---------- draw: Python ----------
from compas.geometry import Transformation
from compas.geometry import Frame
from compas.datastructures import mesh_transformed
from compas_ghpython.artists import MeshArtist
from compas_ghpython import draw_frame

if show:
    artist = MeshArtist(elem_full.mesh)
    M = [artist.draw()]
    F = [draw_frame(elem_full.frame)]
    #S = [draw_frame(elem_full._source.frame)]
    S = [draw_frame(elem_full.tool_frame)]
    
    
    artist = MeshArtist(elem_half.mesh)
    M += [artist.draw()]
    F += [draw_frame(elem_half.frame)]
    #S += [draw_frame(elem_half._source.frame)]
    S = [draw_frame(elem_half.tool_frame)]
# ---------- end draw ----------

list = ValueList({"20", "50", "100", "500", "1000", "5000"}, selected="50")
back = Button()
reset = Button()
start = Button()
stop = Button()
step = Button()
full = Button()

py_2 = PythonScript()  # -> HERE, DATA
# ---------- py_2: Python ----------
import os
import getpass

username = getpass.getuser()
USER_FOLDER = os.path.abspath(os.path.join("C:/Users/", username))
DATA = os.path.abspath(os.path.join(USER_FOLDER,"workspace/projects/assembly_information_model/data"))

print(USER_FOLDER)
print(DATA)
# ---------- end py_2 ----------
pt = Point([<point referenced from the Rhino model> x3])

# ----
# Assembly
y_axis = Curve(<curve referenced from the Rhino model>)
x_axis = Curve(<curve referenced from the Rhino model>)
plane = PythonScript(plane_axes=[x_axis, y_axis])  # -> plane; inputs plane_axes: list of Curve
# ---------- plane: Python ----------
import Rhino.Geometry as rg

x_axis, y_axis = plane_axes

x_axis = rg.Line(x_axis.PointAtStart, x_axis.PointAtEnd)
y_axis = rg.Line(y_axis.PointAtStart, y_axis.PointAtEnd)

if x_axis.From.DistanceTo(y_axis.From) < 0.01:
    origin = x_axis.From
    xvec = x_axis.Direction
    yvec = y_axis.Direction
elif x_axis.To.DistanceTo(y_axis.To) < 0.01:
    origin = x_axis.To
    xvec = -x_axis.Direction
    yvec = -y_axis.Direction
elif x_axis.From.DistanceTo(y_axis.To) < 0.01:
    origin = x_axis.From
    xvec = x_axis.Direction
    yvec = -y_axis.Direction
elif x_axis.To.DistanceTo(y_axis.From) < 0.01:
    origin = x_axis.To
    xvec = -x_axis.Direction
    yvec = y_axis.Direction

plane = rg.Plane(origin, xvec, yvec)
# ---------- end plane ----------
cp_new = Plane(plane)
generate_assembly = GhPythonScript(elem_full=elem_def.elem_full, elem_half=elem_def.elem_half, transform=Toggle(True), ptransf=cp_new, attr_pts=pt)  # -> assembly; inputs ptransf: Plane, attr_pts: list of Point3d
# ---------- generate_assembly: Python ----------
import Rhino.Geometry as rg
import math
from scriptcontext import sticky as st


from compas.geometry import Frame
from compas.geometry import Transformation
from compas.geometry import Rotation
from compas.geometry import Translation
from compas.geometry import Point

from compas_ghpython import draw_frame

from assembly_information_model.assembly import Assembly

import Rhino.Geometry as rg



length, width, height = [elem_full._source.xsize, elem_full._source.ysize, elem_full._source.zsize]
#print(width, length, height)

COURSES = 25
BRICKS_PER_COURSE = 4

MORTAR_PERPENDS = 0.025


total_length = BRICKS_PER_COURSE * length + (BRICKS_PER_COURSE - 1) * MORTAR_PERPENDS
gap_even = MORTAR_PERPENDS
gap_uneven = MORTAR_PERPENDS
gap_uneven = (total_length - (BRICKS_PER_COURSE * (length)))/BRICKS_PER_COURSE


assembly = Assembly() # initialize an empty assembly class
planes = [] # just for vizualisation


for course in range(COURSES):
    dy = course * height
    half_brick_ends = course % 2 != 0
    gap = gap_even if course % 2 == 0 else gap_uneven
    dx = 0

    bricks_in_course = BRICKS_PER_COURSE + (1 if half_brick_ends else 0)
    for j in range(bricks_in_course):

        first = j == 0
        last = j == bricks_in_course - 1

        is_half_brick = (first or last) and half_brick_ends

        if is_half_brick:
            if last:
                T = Translation.from_vector([dx - width/2, 0, dy])
            else:
                T = Translation.from_vector([dx - width/2-gap/2, 0, dy])
            e = elem_half.transformed(T)
            dx += width+gap/2
        else:
            T = Translation.from_vector([dx, 0, dy])
            e = elem_full.transformed(T)
            dx += length
        
        cpt = e.frame.point
        
        #apply rotation to the bricks according to the distance of the attractor points
        min_dist = 10
        for attr_pt in attr_pts:
            dist =  attr_pt.DistanceTo(rg.Point3d(cpt.x, cpt.y, cpt.z))
            if dist<min_dist:
                min_dist = dist
            #print dist
        dist = min_dist
        R = Rotation.from_axis_and_angle([0,0,1], math.radians(1/(0.3*dist*dist)), point=e.frame.point) 
        e.transform(R)
        
        planes.append(draw_frame(e.tool_frame)) #only forvisualizing in gh
        
        typology = "half" if is_half_brick else "full"
        assembly.add_element(e, course=course, typology=typology)
        dx += gap

#        if j < bricks_in_course - 1:
#            assembly.add_connection(j, j+1)

if transform:
    T = Transformation.from_frame_to_frame(Frame.worldXY(), Frame(ptransf.Origin, ptransf.XAxis, ptransf.YAxis))
    assembly.transform(T)
    assembly.network.transform(T)
# ---------- end generate_assembly ----------

show_2 = BooleanToggle(False)
update_network = PythonScript(DATA=py_2.DATA, compute_interfaces_numpy=show_2, assembly=generate_assembly)  # -> assembly
# ---------- update_network: Python ----------
from assembly_information_model.assembly.courses import assembly_courses, assembly_with_interfaces_courses


if compute_interfaces_numpy:
    import os
    from compas.rpc import Proxy
    from assembly_information_model.assembly import Assembly
    p = Proxy('assembly_information_model.assembly.interfaces_numpy')
    p.stop_server()
    p.start_server()

    filename_before = "brickwall_ex2.json"
    filename_after = "brickwall_interfaces_ex2.json"

    PATH_BEFORE = os.path.join(DATA, filename_before)
    PATH_AFTER = os.path.join(DATA, filename_after)
    
    # the assembly has to be serialized such that it can be called from CPython
    assembly.to_json(PATH_BEFORE)
    
    # call the CPython Function using COMPAS RPC
    p.assembly_interfaces_numpy_fromtojson(PATH_BEFORE, PATH_AFTER, nmax=10, amin = 0.0001)

    assembly = Assembly.from_json(PATH_AFTER)


# now compute the courses
assembly_courses(assembly)

# example test: get the bottom keys
c_min = min(assembly.network.nodes_attribute(name='course'))
#print(c_min)
#keys_on_bottom = list(assembly.network.vertices_where({'course': c_min}))
#print(keys_on_bottom)

# example test: get the top keys
c_max = max(assembly.network.nodes_attribute(name='course'))
#print(c_max)
#keys_on_top = list(assembly.network.vertices_where({'course': c_max}))
#print(keys_on_top)
# ---------- end update_network ----------

# ----
# Path Mapping
pln = Plane(PlaneXY(0, 0, 0))
base = PythonScript(base_plane=pln)  # -> base_frame, base_plane
# ---------- base: Python ----------
from compas.geometry import Frame
from compas.geometry import Transformation, Rotation
from compas_ghpython import draw_frame
import math
import Rhino.Geometry as rg


"""
origin = [0,0,0]
xaxis = [1,0,0]
yaxis = [0,1,0]

base_frame = Frame(list(origin), list(xaxis), list(yaxis))
"""

bp = base_plane
base_frame = Frame(bp.Origin, bp.XAxis, bp.YAxis)

#bf = Frame(bp.Origin, bp.XAxis, bp.YAxis)
#T = Transformation.change_basis(Frame.worldXY(), bf)
#base_frame = Frame.worldXY()
#base_frame.transform(T)
# ---------- end base ----------
pup_half = Plane(Plane(origin=(-0.9194638955, 0.6425, -0.437), x=(1, 0, 0), y=(0, -1, 0)))
pup_full = Plane(Plane(origin=(-0.8594638955, 0.5175, -0.437), x=(1, 0, 0), y=(0, -1, 0)))
path_mapping = GhPythonScript(
    assembly=update_network,
    elem_full=elem_def.elem_full,
    elem_half=elem_def.elem_half,
    pick_up_plane_WCS_full=pup_full,
    pick_up_plane_WCS_half=pup_half,
    base_frame=base.base_frame)  # -> out, path_planes, assembly, elem_pickup_full, elem_pickup_half; inputs pick_up_plane_WCS_full: Plane, pick_up_plane_WCS_half: Plane
# ---------- path_mapping: Python ----------
from scriptcontext import sticky as st
from compas.geometry import Frame, Translation, Transformation
from compas_ghpython import draw_frame
from compas_ghpython.artists import MeshArtist

import Rhino.Geometry as rg

from assembly_information_model.assembly import Assembly

""" Procedure 
00. Safe plane above pickup plane
10. Pickup plane
20. Safe plane above pickup plane
25. (optional) Transition planes to avoid self-collision
30. Safe plane above release plane
40. Release plane
50. Safe plane above pickup plane
"""

path_planes = []

pup_full = pick_up_plane_WCS_full
pup_half = pick_up_plane_WCS_half
pickup_frame_full = Frame(pup_full.Origin, pup_full.XAxis, pup_full.YAxis)
pickup_frame_half = Frame(pup_half.Origin, pup_half.XAxis, pup_half.YAxis)

#visualize full brick at pickup location
T = Transformation.from_frame(pickup_frame_full)
e = elem_full.transformed(T)

artist = MeshArtist(e.mesh)
elem_pickup_full = artist.draw()

#visualize half brick at pickup location
T = Transformation.from_frame(pickup_frame_half)
e = elem_half.transformed(T)

artist = MeshArtist(e.mesh)
elem_pickup_half = artist.draw()



safe_level = 0.250

#stack_num = 10
#y_loc = 0
#print list(pickup_frame.point) + list(pickup_frame.quaternion)

for key, element, data in assembly.elements(data=True):
    string_message = "This is the element with the key index %i" %key
    print string_message
    #print data
    
    if data['typology'] == "full":
        element_pickup = pickup_frame_full
    else:
        element_pickup = pickup_frame_half

    _10frame = element_pickup
    _40frame = element.tool_frame
    
    _00frame = _10frame.transformed(Translation.from_vector(_10frame.zaxis*-safe_level))
    _20frame = _00frame
    
    _30frame = _40frame.transformed(Translation.from_vector(_40frame.zaxis*-safe_level))
    _50frame = _30frame
    
    element.path = [_00frame, _10frame, _20frame, _30frame, _40frame, _50frame]
    tfs = [path_planes.append(draw_frame(frame)) for frame in element.path]
    #element.robot_base_frame = robot.base_frame
    
    #store also the robot origin in the attributes of the element
    #print assembly.data
    #data.update(robot_base_frame = base_frame.to_data())

#store also the robot origin in the attributes of the assembly
assembly.network.attributes.update(robot_base_frame = base_frame.to_data())
print assembly.network.attributes['robot_base_frame']
# ---------- end path_mapping ----------
pln_2 = Plane(path_mapping.path_planes)
geo = Geometry([path_mapping.elem_pickup_full, path_mapping.elem_pickup_half])
preview = CustomPreview(Geometry=geo, Shader=ColourSwatch(SwatchColor=RGB(255, 237, 237)))

# ----
# to JSON
export = Button()
export_2 = Button()
export_3 = PythonScript(DATA=py_2.DATA, assembly=update_network, export_to_json=export, export_for_xr=export_2)
# ---------- export_3: Python ----------
import os
from compas.datastructures.mesh import mesh_quads_to_triangles
from compas.datastructures.mesh import mesh_unify_cycles

if export_to_json:
    
    filename = "ex2_brickwall.json"
    PATH = os.path.join(DATA, filename)
    
    # the assembly has to be serialized such that it can be called from CPython
    assembly.to_json(PATH)
    

if export_for_xr:
    
    for key, e in assembly.elements():
    
        #convert to trimesh
        mesh_quads_to_triangles(e._mesh, check_angles=False)
        #mesh_unify_cycles(e._mesh)
        #print e._mesh.faces
        #print e._mesh.face_vertices(list(e._mesh.faces())[0])

    filename = "xrtest_2.json"
    PATH = os.path.join(DATA, filename)
    print(PATH)

    assembly.to_json(PATH)
    #assembly.network.update_default_node_attributes()
    #assembly.export_to_json_for_xr()


assembly.network.update_default_node_attributes({"is_built":False, "idx_v":None, "custom_attr_1":None, "custom_attr_2":None, "custom_attr_3":None})
 
for key, element in assembly.elements():
    idx_v = assembly.network.node_attribute(key, "course")
    assembly.network.node_attribute(key, "idx_v", idx_v)
    assembly.network.node_attribute(key, "is_built", False)
# ---------- end export_3 ----------

# ----
# Draw
show_3 = BooleanToggle(True)
panel = Panel("Assembly Visualization")
show_4 = BooleanToggle(True)
show_5 = BooleanToggle(False)
show_6 = BooleanToggle(False)
show_7 = BooleanToggle(True)
counter = CountThroughList(assembly=update_network, start=start, stop=stop, step=step, step_back=back, reset=reset, full=full, interval=list)  # -> item, counter; inputs start: Boolean, stop: Boolean, step_back: Boolean
# ---------- counter: Python ----------
from scriptcontext import sticky as st
from compas_ghpython import update_component


L = list(assembly.elements())
# store data in component
guid = str(ghenv.Component.InstanceGuid)
counter_key = "counter_" + guid
running_key = "running_" + guid

if counter_key not in st:
    st[counter_key] = 0

if running_key not in st:
    st[running_key] = False
    

if st[running_key]:
    if st[counter_key] < len(L) - 1:
        st[counter_key] += 1
        update_component(ghenv, interval)
    else:
        st[counter_key] = 0
        st[running_key] = False
    
    
if start:
    st[running_key] = True

if stop:
    st[running_key] = False

if step:
    if st[counter_key] < len(L) - 1:
        st[counter_key] += 1

if step_back:
    if st[counter_key] < len(L):
        st[counter_key] -= 1

if reset:
    st[counter_key] = 0

if full:
    st[counter_key] = len(L)-1

if len(L):
    item = L[st[counter_key]]



#st["visualisation_counter"] = st[counter_key]
#st[counter_key]= 50
counter = st[counter_key]
# ---------- end counter ----------
idx = Panel(counter.counter)
draw_2 = PythonScript(
    assembly=update_network,
    current_key=idx,
    show_current_element=show_4,
    show_course=show_5,
    show_all=show_6,
    show_until_key=show_7,
    show_network=show_3)  # -> G_element, G_elements, G_course, current_tool_plane, current_path_planes, G_nodes, G_edges; inputs current_key: Int32
# ---------- draw_2: Python ----------
import os
import sys

import math

import Rhino.Geometry as rg

from compas_ghpython.artists import MeshArtist
from compas_ghpython.artists import NetworkArtist
from compas_ghpython import draw_frame


G_element = []
G_elements = []
G_course = []
G_nodes = []
G_edges = []

key_index = assembly.network.key_index()
keys = [key_index[key] for key in assembly.network.nodes()]

if show_current_element:
    element = assembly.element(current_key)
    artist = MeshArtist(element.mesh)
    mesh = artist.draw()
    G_element.append(mesh)

if show_course:
    course = assembly.network.node_attribute(key=current_key, name='course')
    keys_in_course = list(assembly.network.nodes_where({'course': course}))
    elements = [assembly.element(key) for key in keys_in_course]
    for element in elements:
        artist = MeshArtist(element.mesh)
        mesh = artist.draw_mesh()
        G_course.append(mesh)

if show_all and not show_until_key:
    elements = [assembly.element(key) for key in keys]
    for element in elements:
        artist = MeshArtist(element.mesh)
        mesh = artist.draw()
        G_elements.append(mesh)

if show_until_key:
    elements = [assembly.element(key) for key in keys]
    for element in elements[0:current_key+1]:
        artist = MeshArtist(element.mesh)
        mesh = artist.draw()
        G_elements.append(mesh)
        
if show_network:
    G_nodes, G_edges = NetworkArtist(assembly.network).draw()

tool_planes_WCS = [draw_frame(e.tool_frame) for e in elements]
current_tool_plane = tool_planes_WCS[current_key]
current_path_planes = [draw_frame(plane) for plane in assembly.element(current_key).path]
# ---------- end draw_2 ----------
geo_2 = Geometry(draw_2.G_element)
pln_3 = Plane(draw_2.current_tool_plane)
geo_3 = Geometry(draw_2.G_course)
preview_2 = CustomPreview(Geometry=geo_2, Shader=ColourSwatch(SwatchColor=RGB(255, 143, 143)))
preview_3 = CustomPreview(Geometry=geo_3, Shader=ColourSwatch(SwatchColor=RGB(255, 204, 0)))

line = Line(draw_2.G_edges)
pt_2 = Point(draw_2.G_nodes)

pln_4 = Plane(draw_2.current_path_planes)
geo_4 = Geometry(draw_2.G_elements)
preview_4 = CustomPreview(Geometry=geo_4, Shader=ColourSwatch(SwatchColor=RGB(255, 255, 255)))

preview_5 = CustomPreview(Geometry=pt_2, Shader=ColourSwatch(SwatchColor=RGB(0, 0, 0)))
preview_6 = CustomPreview(Geometry=line, Shader=ColourSwatch(SwatchColor=RGB(255, 122, 122)))
