# Grasshopper definition ex3_cellularized_part.ghx (Grasshopper 1.0.8)
# plug-ins: RhinoCodePluginGH

# ----
# Create a part from shape
part = Python3Script()  # -> out, brick
# ---------- part: Python ----------
from compas.geometry import Frame
from compas.geometry import Vector
from compas.geometry import Box

from assembly_information_model import Part, CellularizedPart

# dimensions full brick
width = 0.12
length = 0.25
height = 0.065

# create bricks
tool_frame = Frame([0, 0, 0], [1, 0, 0], [0, -1, 0])
brick_geometry = Box(length, width, height, Frame.worldXY(), 'box')
brick = CellularizedPart.from_shape(brick_geometry, grid=(4, 2, 2), name="brick", frame=tool_frame)

import random

brick.set_damage_scores([random.random() for _ in range(brick.num_cells)])
# ---------- end part ----------

# ----
# Create a part from mesh
mesh = Mesh(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)
part_2 = Python3Script(mesh=mesh, box_mode=Toggle(False))  # -> out, timber, timber_mesh; inputs mesh: Mesh
# ---------- part_2: Python ----------
from compas.geometry import Frame
from compas.geometry import Vector
from compas.geometry import Box
from compas.geometry import Translation
from compas_rhino.conversions import mesh_to_compas, mesh_to_rhino

from assembly_information_model import Part, CellularizedPart

compas_mesh = mesh_to_compas(mesh)

# move the mesh so its centroid sits at the world origin
T = Translation.from_vector([-c for c in compas_mesh.centroid()])
compas_mesh.transform(T)
timber_mesh = mesh_to_rhino(compas_mesh)

tool_frame = Frame(compas_mesh.centroid(), [1, 0, 0], [0, -1, 0])
timber = CellularizedPart.from_mesh(compas_mesh, grid=(4, 8, 3), box_mode=box_mode, name="timber", frame=tool_frame)

import random

timber.set_damage_scores([random.random() for _ in range(timber.num_cells)])
# ---------- end part_2 ----------

# ----
# Unload Python modules
button = Button()
unload = Python3Script(unload=button)  # -> out, a
# ---------- unload: Python ----------
from compas_rhino import unload_modules

unload_modules('assembly_information_model')
# ---------- end unload ----------

list = ValueList({"Brick": 0, "Timber": 1}, selected="Timber")
select = PickNChoose(Pattern=list, Stream0=part.brick, Stream1=part_2.timber)

# ----
# Visualise a cellularized part
toggle = BooleanToggle(True)
show = Python3Script(part=select, show=toggle)  # -> out, plane, mesh, cell_meshes, cell_centers, cell_bins, cell_damage
# ---------- show: Python ----------
from compas_rhino.conversions import mesh_to_rhino, box_to_rhino, frame_to_rhino
from compas_rhino.conversions import point_to_rhino

if show:
    # extract the mesh of the part for visualization
    full_mesh = part.mesh
    # convert to rhino mesh
    mesh = [mesh_to_rhino(full_mesh)]

    # extract the frame of the part for visualization
    full_frame = part.frame
    # convert to rhino plane
    plane = [frame_to_rhino(full_frame)]

    # one separate rhino mesh per cell (all cells, not just active ones):
    # the clipped irregular mesh if box_mode=False was used to build `part`,
    # otherwise (or if a cell just happens to be untouched) the plain grid box
    net = part.cell_network
    cell_meshes = [mesh_to_rhino(net.cell_mesh(ckey) or net.cell_to_mesh(ckey)) for ckey in net.cells()]

    # parallel lists so you can colour/filter cells downstream in GH
    cell_active = [net.cell_attribute(ckey, "active") for ckey in net.cells()]
    cell_centers = [point_to_rhino(net.cell_centroid(ckey)) for ckey in net.cells()]
    cell_bins = [net.cell_attribute(ckey, "bin") for ckey in net.cells()]
    cell_damage = [net.cell_attribute(ckey, "damage_score") for ckey in net.cells()]
    print(cell_bins)
# ---------- end show ----------
gradient = Gradient(
    LowerLimit=0,
    UpperLimit=1,
    Parameter=show.cell_damage,
    stops=[0: RGB(192, 192, 0), 0.508: RGB(255, 192, 128), 1: RGB(220, 0, 40)])
pln = Plane(show.plane)
geo = Geometry(show.mesh)
geo_2 = Geometry(show.cell_meshes)
preview = CustomPreview(Geometry=geo_2, Material=gradient)
tag = TextTag(Location=show.cell_centers, Text=show.cell_bins, Colour=RGB(0, 0, 0))

# ----
# Export to JSON
export = Button()
path = Python3Script()  # -> out, DATA
# ---------- path: Python ----------
import os
import getpass

username = getpass.getuser()
USER_FOLDER = os.path.abspath(os.path.join("C:/Users/", username))
DATA = os.path.abspath(os.path.join(USER_FOLDER,"workspace/projects/assembly_information_model/data"))

print(USER_FOLDER)
print(DATA)
# ---------- end path ----------
export_2 = Python3Script(DATA=path.DATA, assembly=select, export=export)  # -> out
# ---------- export_2: Python ----------
import os

if export:
    
    filename = "cell_wall.json"
    PATH = os.path.join(DATA, filename)
    
    # the assembly has to be serialized such that it can be called from CPython
    assembly.to_json(PATH)
# ---------- end export_2 ----------
